% Simulink data dictionary configuration_dictionary.sldd

gearbox_ratio = Simulink.Parameter(40.61)
wheel_diameter = Simulink.Parameter(360, Unit="mm")
joy_max_steering_angle = Simulink.Parameter(1.047198, Unit="rad")
vehicle_wheelbase = Simulink.Parameter(2367, Unit="mm")
vehicle_track = Simulink.Parameter(877, Unit="mm")
min_motor_rpm = Simulink.Parameter(30, Unit="rpm")
mobotic_mechanical_offset = Simulink.Parameter(-30, Unit="deg")

CAN_MESSAGE_BUS = Simulink.Bus()
  Extended: uint8
  Length: uint8
  Remote: uint8
  Error: uint8
  ID: uint32
  Timestamp: double
  Data: uint8[8]

set_abs_pos_can_message = Simulink.Parameter(uint8([35; 144; 55; 0; 0; 0; 0; 0]))  % The setAbsPosCANMessage is defined as 8 bytes message for CANOpen Mobotics.
  % The Data should be placed on the last 4 bytes of the message (int32)

read_pos_request_can_message = Simulink.Parameter(uint8([64; 98; 55; 0; 0; 0; 0; 0]))
udp_odometry_magic_word = Simulink.Parameter(uint8([77 79 80 83]))
udp_odometry_header_version = Simulink.Parameter(uint8([0 2]))
udp_odometry_payload_length = Simulink.Parameter(uint8([0 24]))
udp_odometry_payload_type = Simulink.Parameter(uint8([6 66]))
udp_odometry_msg_type = Simulink.Parameter(uint8([0 2]))
udp_odometry_msg_type_version = Simulink.Parameter(uint8([0 2]))
joy_speed = Simulink.Parameter(140, Unit="mm/s")
joy_boost_speed_multiplier = Simulink.Parameter(3)
joy_max_speed_multiplier = Simulink.Parameter(6)
max_curtis_speed = Simulink.Parameter(2100, Unit="rpm")
cubic_gain_joystick_param = Simulink.Parameter(0.5, DataType="double")
max_steering_angle_deg = Simulink.Parameter(60, Unit="deg")
Sig = Simulink.Signal()
L_limited = Simulink.Parameter(1, Unit="m")
Sig1 = Simulink.Signal()
yaw_diff_threshold = Simulink.Parameter(20, Unit="deg")
tstep = Simulink.Parameter(0.001, Unit="s")
SharedConfig = Simulink.ConfigSet(StartTime="0", StopTime="inf", FixedStep="tstep", Solver="FixedStepDiscrete", ProdHWDeviceType="Intel->x86-64 (Linux 64)", SystemTargetFile="speedgoat.tlc", TargetLang="C++")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
min_SVs2RTK = Simulink.Parameter(5)

IOs_curtains_bool = Simulink.Bus()
  curtain_left_up: boolean
  curtain_left_down: boolean
  curtain_right_up: boolean
  curtain_right_down: boolean

IOs_flaps_bool = Simulink.Bus()
  flap_front_left_up: boolean
  flap_front_left_down: boolean
  flap_front_right_up: boolean
  flap_front_right_down: boolean
  flap_rear_left_up: boolean
  flap_rear_left_down: boolean
  flap_rear_right_up: boolean
  flap_rear_right_down: boolean

IOs_pallets_bool = Simulink.Bus()
  sensor_pallet_front_left: boolean
  sensor_pallet_rear_left: boolean
  sensor_pallet_front_right: boolean
  sensor_pallet_rear_right: boolean

max_gnss_height = Simulink.Parameter(710, Unit="m")
min_gnss_height = Simulink.Parameter(690, Unit="m")
max_RCU_speed = Simulink.Parameter(520, Unit="rpm")